# Grasshopper definition HLD lift floor functionality.gh (Grasshopper 1.0.8)
# plug-ins: Rhino.Inside for Autodesk Revit

location = ProjectLocation()  # -> SiteLocation, SharedSite, SurveyPoint, ProjectBasePoint
graphical_element = GraphicalElement(<floor referenced from the Revit model>)
pt = Point(location.ProjectBasePoint)
graphical_element_2 = GraphicalElement(<floor referenced from the Revit model>)
Z = UnitZ(Factor=Slider(10000, range=0..10000))
orient = Orient(Geometry=pt, Source=location.SharedSite, Target=PlaneXY(0, 0, 0))  # -> Geometry, Transform
boundprof = HostBoundaryProfile(Host=graphical_element)  # -> Plane, Profile
pt_2 = Point(orient.Geometry)
move = Move(Geometry=boundprof.Profile, Motion=Z)  # -> Geometry, Transform
cp = ControlPoints(Curve=move.Geometry)  # -> flatten(Points), Weights, Knots
cullpt = CullDuplicates(Points=cp.Points, Tolerance=0.1, CullMode=3)  # -> Points, Indices, Valence
Z_2 = UnitZ(Factor=1)
geo = Geometry(<mesh referenced from the Rhino model>)
neg = Negative(Value=Z_2)
meshray = MeshRay(Mesh=geo, Point=cullpt.Points, Direction=neg)  # -> Point, Hit
dispatch = Dispatch(List=cullpt.Points, DispatchPattern=meshray.Hit)  # -> ListA, ListB
brep = Brep(<brep referenced from the Rhino model>)
pt_3 = Point(dispatch.ListB)
meshray_2 = MeshRay(Mesh=brep, Point=pt_3, Direction=neg)  # -> Point, Hit
pt_4 = Point(flatten([meshray.Point, meshray_2.Point]))
h_shape = HostShape(Host=graphical_element, Points=pt_4)  # -> Host, Exteriors, Interiors
