# Grasshopper definition Pavement pattern example.gh (Grasshopper 1.0.8)
# plug-ins: LunchBox

# ---- group: Base Plan Curve
# Pavement pattern example
crv = Curve(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)

# ----
brick_width = Slider(0.31, range=0.1..0.7)
brick_height = Slider(0.3, range=0.03..0.3)

wall_height = Slider(7, range=3..7)
Z = UnitZ(Factor=wall_height)
move = Move(Geometry=crv, Motion=Z)  # -> Geometry, Transform
rulesrf = RuledSurface(CurveA=crv, CurveB=move.Geometry)
srf = Surface(rulesrf)
dim = Dimensions(Surface=srf)  # -> UDimension, VDimension
division = Division(A=dim.UDimension, B=brick_height)
division_2 = Division(A=dim.VDimension, B=brick_width)
round = Round(Number=division)  # -> Nearest, Floor, Ceiling
round_2 = Round(Number=division_2)  # -> Nearest, Floor, Ceiling
quadstag = StaggeredQuadPanels(Surface=srf, UDivisions=round_2.Nearest, VDivisions=round.Nearest)
smesh = SimpleMesh(Brep=quadstag)  # -> flatten(Mesh)

# ---- group: Attractor Position(s)
md_slider = MDSlider(SliderMode=0, slider_value=Point(0, 1, 0.5), x_domain=Domain(0, 1), y_domain=Domain(0, 1), z_domain=Domain(0, 1))
md_slider_2 = MDSlider(
    SliderMode=0,
    slider_value=Point(0.734375, 0.06640625, 0.5),
    x_domain=Domain(0, 1),
    y_domain=Domain(0, 1),
    z_domain=Domain(0, 1))

# ----
# Sort the bricks based on their distance
# to the closest attractor curve and then,
# divide them into 3 groups:
#      1. Nearest zone to attractor for start color.
#      2. Middle zone for color interpolation.
#      3. Farthest zone to attractor for end color.
image = ImageSampler(Filter="Colour", Interpolate=False, Umax=1, Umin=0, Vmax=1, Vmin=0, Wrap=1)

# ---- group: Sample Attractor
crv_2 = Curve(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)
crv_3 = Curve(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)

# ----
image_2 = ImageSampler(Filter="Colour", Interpolate=False, Umax=1, Umin=0, Vmax=1, Vmin=0, Wrap=1)

start_color = ColourSwatch(SwatchColor=RGB(230, 116, 9))
end_color = ColourSwatch(SwatchColor=RGB(255, 255, 255))

random_seed = Slider(0, range=0..10)
randomness = Slider(0.275, range=0..1)

image_3 = ImageSampler(Filter="Colour", Interpolate=False, Umax=1, Umin=0, Vmax=1, Vmin=0, Wrap=1)

# ----
# Attractor Curve(s)
# You can also import your
# attractor curve(s) from Rhino.
# There can be distance between
# curves and wall surface.
mesh = Mesh(smesh)
srf_2 = Surface(srf)
attractor_type = ValueList({"U Direction": 0, "V Direction": 1, "Both U & V": 2}, selected="V Direction")
iso = IsoCurve(Surface=reparameterize(srf_2), UVPoint=[md_slider_2, md_slider])  # -> UIsocurve, VIsocurve
stream_filter = StreamFilter(Gate=attractor_type, Stream0=iso.UIsocurve, Stream1=iso.VIsocurve, Stream2=[iso.UIsocurve, iso.VIsocurve])  # -> flatten(Stream)
facen = FaceNormals(Mesh=mesh)  # -> flatten(Centers), Normals
interpolation_ratio = Slider(0.599, range=0.1..1)
first_color_ratio = Slider(0.212, range=0..1)
addition = Addition(A=first_color_ratio, B=interpolation_ratio)

# ---- group: Attractor Curve(s)
crv_4 = Curve(stream_filter)

# ----
pull = PullPoint(Point=facen.Centers, Geometry=crv_4, ClosestOnly=True)  # -> ClosestPoint, Distance, Index
sort = SortList(Keys=pull.Distance, ValuesA=facen.Centers, ValuesB=mesh)  # -> Keys, ValuesA, ValuesB
item = ListItem(List=reverse(sort.Keys), Index=0, Wrap=True)
multiplication = Multiplication(A=item, B=first_color_ratio)
multiplication_2 = Multiplication(A=item, B=addition)
smaller = SmallerThan(FirstNumber=sort.Keys, SecondNumber=multiplication)  # -> SmallerThan, OrEqualTo
dispatch = Dispatch(List=sort.Keys, DispatchPattern=smaller.SmallerThan)  # -> ListA, ListB
dispatch_2 = Dispatch(List=sort.ValuesB, DispatchPattern=smaller.SmallerThan)  # -> ListA, ListB
smaller_2 = SmallerThan(FirstNumber=dispatch.ListB, SecondNumber=multiplication_2)  # -> SmallerThan, OrEqualTo
mesh_2 = Mesh(dispatch_2.ListB)
dispatch_3 = Dispatch(List=mesh_2, DispatchPattern=smaller_2.SmallerThan)  # -> ListA, ListB

# ---- group: First Color Bricks
mesh_3 = Mesh(dispatch_2.ListA)

# ---- group: Last Color Bricks
mesh_4 = Mesh(dispatch_3.ListB)

# ---- group: Interpolation Bricks
mesh_5 = Mesh(dispatch_3.ListA)

# ----
# Color List (in Order)
# You can also input your
# custom color list here.
# - There must be at least 2 colors.
# - Pay attention to the order of colors.
#   The order will be kept when calculating
#   the distance from attractors.
color_count = Slider(4, range=2..5)
swatch2 = ColourSwatch(SwatchColor=RGB(255, 217, 0))
swatch3 = ColourSwatch(SwatchColor=RGB(171, 171, 171))
swatch4 = ColourSwatch(SwatchColor=RGB(224, 224, 224))
swatch1 = ColourSwatch(SwatchColor=RGB(255, 0, 0))
merge = Merge(Data1=swatch1, Data2=swatch2, Data3=swatch3, Data4=swatch4)
range = Range(Domain=Domain(0, 1), Steps=expr("x-1", color_count))
merge_2 = Merge(Data1=start_color, Data2=end_color)
interp = InterpolateData(Data=merge_2, Parameter=range, Interpolation=2)
jitter = Jitter(List=mesh_5, Jitter=randomness, Seed=random_seed)  # -> Values, Indices
lng = ListLength(List=jitter.Values)
subtraction = Subtraction(A=lng, B="1")
# Define the color list and divide the bricks
# in the interpolation zone into a number of
# groups equal to color list length. Use Jitter
# to add a parametric randomness to groups.
panel = Panel("1")

# ---- group: Custom Color List
colour = Colour(merge)

# ---- group: Color List (in order)
colour_2 = Colour(flatten(interp))

# ----
lng_2 = ListLength(List=colour_2)
division_3 = Division(A=lng, B=lng_2)
round_3 = Round(Number=division_3)  # -> Nearest, Floor, Ceiling
series = Series(Start=0, Step=round_3.Nearest, Count=lng_2)
merge_3 = Merge(Data1=flatten(series), Data2=flatten(subtraction))
consec = ConsecutiveDomains(Numbers=merge_3, Additive=invert(True))
split = SplitList(List=consec, Index=panel)  # -> ListA, ListB
dedomain = DeconstructDomain(Domain=split.ListB)  # -> Start, End
dom = ConstructDomain(DomainStart=expr("x+1", dedomain.Start), DomainEnd=dedomain.End)
merge_4 = Merge(Data1=flatten(split.ListA), Data2=flatten(dom))
subset = SubList(List=jitter.Values, Domain=merge_4, Wrap=True)  # -> simplify(List), Index

mesh_6 = Mesh(mesh_3)
mesh_7 = Mesh(mesh_4)
mesh_8 = Mesh(subset.List)
tstat = TreeStatistics(Tree=mesh_8)  # -> Paths, Length, Count
item_2 = ListItem(List=tstat.Paths, Index=0, Wrap=True)  # -> Item1, Item
# Add the Start and End zone bricks to the
# shuffled bricks of the interpolation zone
# with the correct branch number so that
# bricks with the same color end up in the
# same list.
flatten = FlattenTree(Tree=mesh_6, Path=item_2.Item)
flatten_2 = FlattenTree(Tree=mesh_7, Path=item_2.Item1)
merge_5 = Merge(Data1=flatten, Data2=flatten_2, Data3=mesh_8)

colour_3 = Colour(simplify(graft(colour_2)))
# Bricks (Categorized)
mesh_9 = Mesh(merge_5)
medges = MeshEdges(Mesh=mesh_9)  # -> NakedEdges, InteriorEdges, NonManifoldEdges
preview = CustomPreview(Geometry=mesh_9, Material=colour_3)
