# Grasshopper definition SUN EYES VIEWS.gh (Grasshopper 1.0.8)
# plug-ins: Rhino.Inside for Autodesk Revit

path = FilePath("C:\Users\alopez\Downloads\AUS_NSW_Sydney.Obs-Observatory.Hill.947680_TMYx\AUS_NSW_Sydney.Obs-Observatory.Hill.947680_TMYx.epw")

# ----
# Import Location from EPW File
panel = Panel("http://climate.onebuilding.org/WMO_Region_4_North_and_Central_America/USA_United_States_of_America/WI_Wisconsin/USA_WI_Madison-Dane.County.Rgnl.AP-Truax.Field.726410_TMY3.zip")
downloadepw = LBDownloadWeather(weather_URL=panel)  # -> epw_file, stat_file, ddy_file; plug-in component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
importloc = LBImportLocation(epw_file=path)  # -> location; plug-in component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

# ----
# Analysis Period for
# Summer Solstice
panel_2 = Panel("21")
analysisperiod = LBAnalysisPeriod(start_month="6", start_day="21", start_hour="9", end_month="6", end_day=panel_2, end_hour="15", timestep="6")  # -> period, hoys, dates; plug-in component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

# ----
# Create Sunpath
panel_3 = Panel("0")
sunpath = LBSunPath(north=Slider(6, range=0..100), location=importloc, hoys=analysisperiod.hoys, scale=Slider(0.2, range=0..10))  # -> report, vectors, altitudes, azimuths, hoys, sun_pts, analemma, daily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; plug-in component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

# ---- group: Run Me!
toggle = BooleanToggle(False)

# ----
# Run Direct Sun Study
geo = Geometry(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)
directsunhours = LBDirectSunHours(vectors=flatten(sunpath.vectors), timestep="6", geometry=flatten(geo), grid_size="2", offset_dist="0.1", run=toggle)  # -> report, points, results, mesh, legend, title, int_mtx; plug-in component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

number_slider = Slider(2, range=0..10)
number_slider_2 = Slider(10000, range=0..10000)
item = ListItem(List=sunpath.sun_pts, Index=number_slider, Wrap=True)
item_2 = ListItem(List=sunpath.vectors, Index=number_slider, Wrap=True)
p_shape = AddDirectShapePoint(Point=sunpath.sun_pts, TrackingMode=2)
c_shape = AddDirectShapeCurve(Curve=sunpath.analemma, TrackingMode=2)
c_shape_2 = AddDirectShapeCurve(Curve=sunpath.daily, TrackingMode=2)
c_shape_3 = AddDirectShapeCurve(Curve=sunpath.compass, TrackingMode=2)
line = LineSDL(Start=item, Direction=Vector(0, 0, 1), Length=number_slider_2)
line_2 = LineSDL(Start=item, Direction=item_2, Length=number_slider_2)
xprod = CrossProduct(VectorA=item_2, VectorB=line, Unitize=False)  # -> Vector, Length
line_3 = LineSDL(Start=item, Direction=xprod.Vector, Length=number_slider_2)
xprod_2 = CrossProduct(VectorA=line_3, VectorB=line_2, Unitize=False)  # -> Vector, Length
neg = Negative(Value=xprod.Vector)
move = Move(Geometry=line_3, Motion=neg)  # -> Geometry, Transform
flip = FlipCurve(Curve=move.Geometry)  # -> Curve, Flag
line_4 = LineSDL(Start=item, Direction=xprod_2.Vector, Length=number_slider_2)
lnln = LineLine(LineA=flip.Curve, LineB=line_4)
rectangle = Rectangle(Plane=lnln, XSize=Domain(-1000, 1000), YSize=Domain(-2000, 2000), Radius=0)  # -> Rectangle, Length
lng = ListLength(List=rectangle.Rectangle)
series = Series(Start=0, Step=1, Count=lng)
m2d_parallel = Make2DParallelView(Projection=rectangle.Rectangle)
panel_4 = Panel("holaAAAA")
_3d_view = Add3DView(Frame=m2d_parallel, Name=series, TrackingMode=2)
cropregn = ViewCropRegion(View=_3d_view, CropView=Toggle(False), CropRegionVisible=True, CropRegion=rectangle.Rectangle)  # -> View, CropView, CropRegionVisible, CropRegion
