# Grasshopper definition Sunlight Hours Cyclops - Cluster 2.gh (Grasshopper 1.0.8)
# plug-ins: Rhino.Inside for Autodesk Revit, LunchBox, Cyclops

ghpython_script = GhPythonScript(Color=ColourSwatch(SwatchColor=RGBA(10, 15, 12, 29)))
# ---------- ghpython_script: Python ----------
import System
import Rhino as rc
import Grasshopper as gh
import GhPython.Assemblies.ExecutingComponent as component

class MyComponent(component):
        
    def RunScript(self,Text,Color):
#        rc.RhinoApp.WriteLine("A 2")
        
        # Assign input variables
        self.txt = Text
        self.col = Color
        self.black = System.Drawing.Color.Black
        
    def DrawForeground(self,sender,arg):
#        rc.RhinoApp.WriteLine("A 3")
        
        # Check component preview/locked, active GH document and Rhino viewport
        if (not ghenv.Component.Hidden and not ghenv.Component.Locked 
            and ghenv.Component.OnPingDocument() == gh.Instances.ActiveCanvas.Document
            and arg.Viewport.Id == arg.RhinoDoc.ActiveDoc.Views.ActiveView.ActiveViewportID):
            
#            rc.RhinoApp.WriteLine("A 4")
            
            # Text is drawn in front of mesh
            #pt = rc.Geometry.Point2d(180,100)
            #arg.Display.Draw2dText(self.txt,self.black,pt,False,100,"Consolas")
            
            # Rectangle is drawn in front of mesh
            rec2d = System.Drawing.Rectangle(10,10,360,1100)
            arg.Display.Draw2dRectangle(rec2d,self.black,2,self.col)
            
    def __enter__(self):
#        rc.RhinoApp.WriteLine("A 1")
        rc.Display.DisplayPipeline.DrawForeground += self.DrawForeground
        
    def __exit__(self):
#        rc.RhinoApp.WriteLine("A 5")
        rc.Display.DisplayPipeline.DrawForeground -= self.DrawForeground
# ---------- end ghpython_script ----------

# ---- group: Draw Embedded Sprite/Bitmap
ghpython_script_2 = GhPythonScript(X=Slider(186, range=0..1000), Y=Slider(68, range=0..1000))  # -> a
# ---------- ghpython_script_2: Python ----------
import System
import Rhino as rc
import Grasshopper as gh
import GhPython.Assemblies.ExecutingComponent as component

class MyComponent(component):
        
    def RunScript(self,X,Y):
        self.pt = rc.Geometry.Point2d(X,Y)
        
    def DrawForeground(self,sender,arg):
        
        # Check component preview/locked, active GH document and Rhino viewport
        if (not ghenv.Component.Hidden and not ghenv.Component.Locked 
            and ghenv.Component.OnPingDocument() == gh.Instances.ActiveCanvas.Document
            and arg.Viewport.Id == arg.RhinoDoc.ActiveDoc.Views.ActiveView.ActiveViewportID):
            
            # Convert image encoded as byte string to .NET bitmap (Base64)
            
            string = "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"
            byteArray = System.Convert.FromBase64String(string)
            bitmap1 = System.Drawing.ImageConverter().ConvertFrom(byteArray)
            
            # Convert to RhinoCommon bitmap and draw sprite
            bitmap2 = rc.Display.DisplayBitmap(bitmap1)
            arg.Display.DrawSprite(bitmap2,self.pt,320,100)
            
    def __exit__(self):
        rc.Display.DisplayPipeline.DrawForeground -= self.DrawForeground
        
    def __enter__(self):
        rc.Display.DisplayPipeline.DrawForeground += self.DrawForeground
# ---------- end ghpython_script_2 ----------

# ----
name_of_option = Panel("Option D1 -")
l1 = GeometryPipeline(
    GroupByLayer=False,
    GroupByType=False,
    IncludeHidden=True,
    IncludeLocked=True,
    LayerFilter="Option 1",
    NameFilter="*",
    SublayerFiltering=True,
    TypeFilter=4)

# ---- group: Irregular volmune
pipeline = GeometryPipeline(
    GroupByLayer=False,
    GroupByType=False,
    IncludeHidden=True,
    IncludeLocked=True,
    LayerFilter="*L6-L10",
    NameFilter="*",
    SublayerFiltering=True,
    TypeFilter=4)  # disabled
number_slider = Slider(3.3, range=0..10)  # disabled
area = Area(Geometry=pipeline)  # -> Area, Centroid; disabled
loft = Loft(Curves=pipeline, Options={Adjust=False, Closed=False, LoftEnds=0, LoftSimp=0, LoftType=0, Rebuild=10, Refit=0.01})  # disabled
contour = Contour(Shape=loft, Point=area.Centroid, Direction=Vector(0, 0, 1), Distance=number_slider)  # disabled
cap = CapHoles(Brep=loft)  # disabled
area_2 = Area(Geometry=contour)  # -> flatten(Area), Centroid; disabled
srf = Surface(flatten(contour))  # disabled
ma = MassAddition(Input=area_2.Area)  # -> flatten(Result), PartialResults; disabled
panel = Panel(ma.Result)  # disabled
panel_2 = Panel(area_2.Area)  # disabled

# ----
c_script = CSharpScript(
    run_me=Toggle(True),
    canvas_back=ColourSwatch(SwatchColor=RGB(230, 230, 230)),
    canvas_grid=ColourSwatch(SwatchColor=RGB(106, 165, 204)),
    Monochromatic_back=ColourSwatch(SwatchColor=RGB(152, 197, 237)),
    Edge=ColourSwatch(SwatchColor=RGB(0, 0, 0)),
    Edge_glow=ColourSwatch(SwatchColor=RGB(255, 255, 255)),
    x=Toggle(False))  # -> out, A; inputs run_me: Boolean, canvas_back: Color, canvas_grid: Color, Monochromatic_back: Color, Edge: Color, Edge_glow: Color, x: Boolean
# ---------- c_script: C# usings ----------
using System.IO;
using System.Linq;
using System.Data;
using System.Drawing;
using System.Reflection;
using System.Windows.Forms;
using System.Xml;
using System.Xml.Linq;
using System.Runtime.InteropServices;

using Rhino.DocObjects;
using Rhino.Collections;
using GH_IO;
using GH_IO.Serialization;
# ---------- c_script: C# ----------
    bool switcher = run_me;


    if (switcher == true)
    {
      Grasshopper.GUI.Canvas.GH_Skin.canvas_grid = canvas_grid;
      Grasshopper.GUI.Canvas.GH_Skin.canvas_back = canvas_back;
      Grasshopper.GUI.Canvas.GH_Skin.canvas_edge = Edge;
      Grasshopper.GUI.Canvas.GH_Skin.canvas_shade = Edge_glow;
      Grasshopper.GUI.Canvas.GH_Skin.canvas_grid_col = 300;
       Grasshopper.GUI.Canvas.GH_Skin.canvas_grid_row = 30;
       Grasshopper.GUI.Canvas.GH_Skin.canvas_mono = x;
       Grasshopper.GUI.Canvas.GH_Skin.canvas_mono_color = Monochromatic_back;
       Grasshopper.GUI.Canvas.GH_Skin.wire_default = Color.FromArgb(250, 255, 100, 100);
    }
    else
    {
      //DEFAULTS
      Grasshopper.GUI.Canvas.GH_Skin.canvas_grid = Color.FromArgb(30, 0, 0, 0);
      Grasshopper.GUI.Canvas.GH_Skin.canvas_back = Color.FromArgb(255, 212, 208, 200);
      Grasshopper.GUI.Canvas.GH_Skin.canvas_edge = Color.FromArgb(255, 0, 0, 0);
      Grasshopper.GUI.Canvas.GH_Skin.canvas_shade = Color.FromArgb(80, 0, 0, 0);
    }
# ---------- end c_script ----------
pipeline_2 = GeometryPipeline(
    GroupByLayer=False,
    GroupByType=False,
    IncludeHidden=True,
    IncludeLocked=True,
    LayerFilter="*Resi",
    NameFilter="*",
    SublayerFiltering=True,
    TypeFilter=4)
construct_point = ConstructPoint(XCoordinate=Slider(18, range=0..30), YCoordinate=Slider(77, range=0..100), ZCoordinate=0)

# ---- group: Draw 2D Text in Screen Space
panel_3 = Panel(""" 



Option D1 - 24/06/25

Reuse of Existing Sussex St Facade""")
dst = DrawScreenText(Text=panel_3, Color=ColourSwatch(SwatchColor=RGB(0, 0, 0)), Height=Slider(13, range=0..30), Point=construct_point)
# ---------- dst: Python ----------
import Rhino as rc
import GhPython.Assemblies.ExecutingComponent as component

class MyComponent(component):
    
    def RunScript(self,Text,Color,Height,Point,Font):
        
        # Assign input parameters
        self.text = Text
        self.color = Color
        self.height = Height
        self.point = rc.Geometry.Point2d(Point.X,Point.Y)
        self.font = Font
        
    def DrawViewportWires(self,arg):
        
        """ Call DrawViewportWires method """
        
        # Draw 2D text
        arg.Display.Draw2dText(self.text,self.color,
        self.point,False,self.height,self.font)
# ---------- end dst ----------

# ----
panel_4 = Panel(c_script.A)
curve = Curve(l1)
curve_2 = Curve(pipeline_2)
building_mass_boundary_and_floors = BuildingMassBoundaryAndFloors(BoundaryCurve=curve_2, NumberOfFloors=Slider(14, range=0..20), FloorHeight=Slider(3.3, range=0..10))  # -> Floors, Mass
building_mass_boundary_and_floors_2 = BuildingMassBoundaryAndFloors(BoundaryCurve=curve, NumberOfFloors=Slider(7, range=0..10), FloorHeight=Slider(3.8, range=0..10000))  # -> Floors, Mass
cap_holes = CapHoles(Brep=building_mass_boundary_and_floors_2.Mass)
cap_holes_2 = CapHoles(Brep=building_mass_boundary_and_floors.Mass)
area_3 = Area(Geometry=building_mass_boundary_and_floors_2.Floors)  # -> Area, Centroid
area_4 = Area(Geometry=building_mass_boundary_and_floors.Floors)  # -> Area, Centroid
custom_preview = CustomPreview(Geometry=cap_holes, Material=ColourSwatch(SwatchColor=RGBA(161, 82, 45, 242)))
custom_preview_2 = CustomPreview(Geometry=cap_holes_2, Material=ColourSwatch(SwatchColor=RGB(45, 161, 130)))
g_shape = AddDirectShapeGeometry(TrackingMode=2)
floor = AddFloor(
    Boundary=<missing>,
    Type=<hostobjecttype referenced from the Revit model>,
    Level=<geometry referenced from the Revit model>,
    Structural=True,
    TrackingMode=2)
mass_addition = MassAddition(Input=area_3.Area)  # -> Result, PartialResults
mass_addition_2 = MassAddition(Input=area_4.Area)  # -> Result, PartialResults
floor_2 = AddFloor(
    Boundary=<missing>,
    Type=<hostobjecttype referenced from the Revit model>,
    Level=<geometry referenced from the Revit model>,
    Structural=True,
    TrackingMode=2)
wires = BrepWireframe(Brep=[building_mass_boundary_and_floors.Floors, building_mass_boundary_and_floors.Mass], Density=-1)  # -> flatten(Wireframe)
wires_2 = BrepWireframe(Brep=[building_mass_boundary_and_floors_2.Floors, cap_holes, building_mass_boundary_and_floors_2.Mass], Density=-1)  # -> flatten(Wireframe)

# ---- group: Draw Curves with Custom Weights
thickness = Slider(2, range=0..20)
dc = DrawCurves(Curves=wires, Weight=thickness, Color=ColourSwatch(SwatchColor=RGB(237, 237, 237)))  # inputs Curves: list
#   port Curves: Curves to render {list,curve}
# ---------- dc: Python ----------
import Rhino as rc
import GhPython.Assemblies.ExecutingComponent as component

class MyComponent(component):
    
    def RunScript(self,Curves,Weight,Color):
        
        # Assign input parameters
        self.curves = Curves
        self.weight = Weight
        self.color = Color
        
    def DrawViewportWires(self,arg):
        
        """ Call DrawViewportWires method """
        
        # Draw curves in loop
        for crv in self.curves:
            arg.Display.DrawCurve(crv,self.color,self.weight)
# ---------- end dc ----------

thickness_2 = Slider(2, range=0..20)
dc_2 = DrawCurves(Curves=wires_2, Weight=thickness_2, Color=ColourSwatch(SwatchColor=RGB(237, 237, 237)))  # inputs Curves: list; same code as dc

# ----
splitmul = SplitBrepMultiple(Brep=cap, Cutters=srf)  # -> graft(Result); disabled
panel_5 = Panel(area_3.Area)
panel_6 = Panel(mass_addition.Result)
panel_7 = Panel(area_4.Area)
panel_8 = Panel(mass_addition_2.Result)
wires_3 = BrepWireframe(Brep=splitmul, Density=-1)  # -> flatten(Wireframe); disabled
colour_swatch = ColourSwatch(SwatchColor=RGBA(201, 8, 8, 196))  # disabled
colour_swatch_2 = ColourSwatch(SwatchColor=RGB(214, 180, 45))  # disabled

# ---- group: Draw Curves with Custom Weights
thickness_3 = Slider(4, range=0..20)  # disabled
swatch = ColourSwatch(SwatchColor=RGB(35, 184, 144))  # disabled
dc_3 = DrawCurves(Curves=wires_3, Weight=thickness_3, Color=swatch)  # inputs Curves: list; disabled; same code as dc

# ----
custom_preview_3 = CustomPreview(Geometry=splitmul, Material=colour_swatch)  # disabled
custom_preview_4 = CustomPreview(Geometry=splitmul, Material=colour_swatch_2)  # disabled

# ---- group: Geometry To Test 01
geometry = Geometry(flatten([cap_holes, cap_holes_2]))

# ----
geo = Geometry([<mesh referenced from the Rhino model> x2, <curve referenced from the Rhino model>, <mesh referenced from the Rhino model> x12, <extrusion referenced from the Rhino model>, <brep referenced from the Rhino model> x3, <curve referenced from the Rhino model>, <mesh referenced from the Rhino model> x37, <curve referenced from the Rhino model>, <mesh referenced from the Rhino model> x3, <extrusion referenced from the Rhino model> x6, <mesh referenced from the Rhino model> x5, <extrusion referenced from the Rhino model>, <brep referenced from the Rhino model> x2, <mesh referenced from the Rhino model>, <curve referenced from the Rhino model> x2])

# ---- group: Context
geometry_2 = Geometry(geo)

# ----
deconstruct_brep = DeconstructBrep(Brep=geometry)  # -> Faces, Edges, Vertices
md_slider = MDSlider(SliderMode=0, slider_value=Point(0.5, 0.5, 0.5), x_domain=Domain(0, 1), y_domain=Domain(0, 1), z_domain=Domain(0, 1))
evaluate_surface = EvaluateSurface(Surface=reparameterize(deconstruct_brep.Faces), Point=md_slider)  # -> Point, Normal, UDirection, VDirection, Frame
devec = DeconstructVector(Vector=evaluate_surface.Normal)  # -> XComponent, YComponent, ZComponent
equals = Equality(FirstNumber=devec.ZComponent, SecondNumber=Slider(1, range=0..1))  # -> Equality, Inequality
md_slider_2 = MDSlider(SliderMode=0, slider_value=Point(0.5, 0.5, 0.5), x_domain=Domain(0, 1), y_domain=Domain(0, 1), z_domain=Domain(0, 1))
dispatch = Dispatch(List=deconstruct_brep.Faces, DispatchPattern=equals.Equality)  # -> ListA, ListB
evaluate_surface_2 = EvaluateSurface(Surface=reparameterize(dispatch.ListB), Point=md_slider_2)  # -> Point, Normal, UDirection, VDirection, Frame
devec_2 = DeconstructVector(Vector=evaluate_surface_2.Normal)  # -> XComponent, YComponent, ZComponent

# ---- group: Cyclops geometry
merge = Merge(Data1=geometry, Data2=geometry_2)
G = Geometry(Mesh=merge, MaterialName="Default Material", Parameter=0, method="Geometry", version="1.0.0.0")
G_2 = GeometryGroup(
    Name="Default Geometry Group",
    Geometry=G,
    VisibilityMask="""{
  "Mask1": true,
  "Mask2": true,
  "Mask3": true,
  "Mask4": true,
  "Mask5": true,
  "Mask6": true,
  "Mask7": true,
  "Mask8": true,
  "BitMap": [
    true,
    true,
    true,
    true,
    true,
    true,
    true,
    true
  ]
}""",
    Transforms={TransformCount=1, Name="Generic", m00=1, m01=0, m02=0, m03=0, m10=0, m11=1, m12=0, m13=0, m20=0, m21=0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},
    IntersectionType="Target",
    method="Geometry Group",
    version="1.0.0.0")

# ---- group: TOP surface/s
item = ListItem(List=dispatch.ListA, Index=0, Wrap=True)

# ----
neg = Negative(Value=Slider(1, range=0..1))
equals_2 = Equality(FirstNumber=devec_2.ZComponent, SecondNumber=neg)  # -> Equality, Inequality

# ---- group: Geometry To Test 02
geometry_3 = Geometry(flatten([cap_holes, cap_holes_2]))  # disabled

# ----
geo_2 = Geometry([<mesh referenced from the Rhino model> x2, <curve referenced from the Rhino model>, <mesh referenced from the Rhino model> x12, <extrusion referenced from the Rhino model>, <brep referenced from the Rhino model> x3, <curve referenced from the Rhino model>, <mesh referenced from the Rhino model> x37, <curve referenced from the Rhino model>, <mesh referenced from the Rhino model> x3, <extrusion referenced from the Rhino model> x6, <mesh referenced from the Rhino model> x5, <extrusion referenced from the Rhino model>, <brep referenced from the Rhino model> x2, <mesh referenced from the Rhino model>, <curve referenced from the Rhino model> x2])  # disabled
dispatch_2 = Dispatch(List=dispatch.ListB, DispatchPattern=equals_2.Equality)  # -> ListA, ListB
md_slider_3 = MDSlider(SliderMode=0, slider_value=Point(0.5, 0.5, 0.5), x_domain=Domain(0, 1), y_domain=Domain(0, 1), z_domain=Domain(0, 1))
brep = Brep(dispatch_2.ListB)

# ---- group: Context
geometry_4 = Geometry(geo_2)  # disabled

# ----
pipeline_3 = GeometryPipeline(
    GroupByLayer=False,
    GroupByType=False,
    IncludeHidden=True,
    IncludeLocked=True,
    LayerFilter="*Park",
    NameFilter="*",
    SublayerFiltering=True,
    TypeFilter=4)  # disabled
evaluate_surface_3 = EvaluateSurface(Surface=reparameterize(brep), Point=md_slider_3)  # -> Point, Normal, UDirection, VDirection, Frame
move = Move(Geometry=brep, Motion=expr("x*0.1", evaluate_surface_3.Normal))  # -> Geometry, Transform
curve_3 = Curve(pipeline_3)  # disabled
dimensions = Dimensions(Surface=move.Geometry)  # -> UDimension, VDimension

# ---- group: Start Time
number_slider_2 = Slider(6, range=0..31)
number_slider_3 = Slider(22, range=0..31)
number_slider_4 = Slider(9, range=0..31)

# ---- group: End Time
number_slider_5 = Slider(6, range=0..31)
number_slider_6 = Slider(22, range=0..31)
number_slider_7 = Slider(15, range=0..31)

# ----
srf_2 = Surface(curve_3)  # disabled
mesh_surface = MeshSurface(Surface=move.Geometry, UCount=dimensions.UDimension, VCount=dimensions.VDimension, Overhang=True, Equalize=False)  # -> flatten(Mesh)

# ---- group: Cyclops geometry
merge_2 = Merge(Data1=geometry_4, Data2=[geometry, geometry_3])  # disabled
G_3 = Geometry(Mesh=merge_2, MaterialName="Default Material", Parameter=0, method="Geometry", version="1.0.0.0")  # disabled
G_4 = GeometryGroup(
    Name="Default Geometry Group",
    Geometry=G_3,
    VisibilityMask="""{
  "Mask1": true,
  "Mask2": true,
  "Mask3": true,
  "Mask4": true,
  "Mask5": true,
  "Mask6": true,
  "Mask7": true,
  "Mask8": true,
  "BitMap": [
    true,
    true,
    true,
    true,
    true,
    true,
    true,
    true
  ]
}""",
    Transforms={TransformCount=1, Name="Generic", m00=1, m01=0, m02=0, m03=0, m10=0, m11=1, m12=0, m13=0, m20=0, m21=0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},
    IntersectionType="Target",
    method="Geometry Group",
    version="1.0.0.0")  # disabled

# ----
mesh_join = MeshJoin(Meshes=mesh_surface)
construct_date = ConstructDate(Year=2025, Month=number_slider_2, Day=number_slider_3, Hour=number_slider_4, Minute=0, Second=0)
construct_date_2 = ConstructDate(Year=2025, Month=number_slider_5, Day=number_slider_6, Hour=number_slider_7, Minute=0, Second=0)
C = LocationFromCoordinates(Latitude="-33.75", Longitude="151.25", method="Location From Coordinates", version="1.0.0.0")

# ---- group: Create panels
deconstruct_mesh = DeconstructMesh(Mesh=mesh_join)  # -> Vertices, Faces, Colours, Normals
deconstruct_face = DeconstructFace(Face=deconstruct_mesh.Faces)  # -> CornerA, CornerB, CornerC, CornerD
merge_3 = Merge(
    Data1=graft(deconstruct_face.CornerA),
    Data2=graft(deconstruct_face.CornerB),
    Data3=graft(deconstruct_face.CornerC),
    Data4=graft(deconstruct_face.CornerD))
list_item = ListItem(List=deconstruct_mesh.Vertices, Index=merge_3, Wrap=True)
construct_mesh = ConstructMesh(Vertices=list_item, Faces={A=0, B=1, C=2, D=3})  # -> flatten(Mesh)
facade_panels = Mesh(construct_mesh)

# ----
tp = FromTimeSpan(StartTime=construct_date, EndTime=construct_date_2, TimeStep=1, method="From Time Span", version="1.1.3.60000")
md_slider_4 = MDSlider(SliderMode=0, slider_value=Point(0.5, 0.5, 0.5), x_domain=Domain(0, 1), y_domain=Domain(0, 1), z_domain=Domain(0, 1))  # disabled
panel_9 = Panel(tp)
evaluate_surface_4 = EvaluateSurface(Surface=reparameterize(srf_2), Point=md_slider_4)  # -> Point, Normal, UDirection, VDirection, Frame; disabled
R = SunRig(NorthVector=Vector(0, 1, 0), Location=C, TimePattern=tp, CutOffElevation=0, method="Sun Rig", version="1.0.0.0")
move_2 = Move(Geometry=srf_2, Motion=expr("x*0.1", evaluate_surface_4.Normal))  # -> Geometry, Transform; disabled
sun_rig = CyclopsObject(R, version="0.0.0.DevBuild")
dimensions_2 = Dimensions(Surface=move_2.Geometry)  # -> UDimension, VDimension; disabled

# ---- group: Start Time
number_slider_8 = Slider(6, range=0..31)  # disabled
number_slider_9 = Slider(22, range=0..31)  # disabled
number_slider_10 = Slider(9, range=0..31)  # disabled

# ---- group: End Time
number_slider_11 = Slider(6, range=0..31)  # disabled
number_slider_12 = Slider(22, range=0..31)  # disabled
number_slider_13 = Slider(15, range=0..31)  # disabled

# ----
mesh_surface_2 = MeshSurface(Surface=move_2.Geometry, UCount=dimensions_2.UDimension, VCount=dimensions_2.VDimension, Overhang=True, Equalize=False)  # -> flatten(Mesh); disabled
mesh_join_2 = MeshJoin(Meshes=mesh_surface_2)  # disabled
pt = Point(<point referenced from the Rhino model>)
m_shape = AddDirectShapeMesh(Mesh=mesh_surface, TrackingMode=2)
construct_date_3 = ConstructDate(Year=2025, Month=number_slider_8, Day=number_slider_9, Hour=number_slider_10, Minute=0, Second=0)  # disabled
construct_date_4 = ConstructDate(Year=2025, Month=number_slider_11, Day=number_slider_12, Hour=number_slider_13, Minute=0, Second=0)  # disabled
panel_10 = Panel("151.25")  # disabled
panel_11 = Panel("-33.75")  # disabled
C_2 = LocationFromCoordinates(Latitude=panel_11, Longitude=panel_10, method="Location From Coordinates", version="1.0.0.0")  # disabled

# ---- group: Create panels
deconstruct_mesh_2 = DeconstructMesh(Mesh=mesh_join_2)  # -> Vertices, Faces, Colours, Normals; disabled
deconstruct_face_2 = DeconstructFace(Face=deconstruct_mesh_2.Faces)  # -> CornerA, CornerB, CornerC, CornerD; disabled
merge_4 = Merge(
    Data1=graft(deconstruct_face_2.CornerA),
    Data2=graft(deconstruct_face_2.CornerB),
    Data3=graft(deconstruct_face_2.CornerC),
    Data4=graft(deconstruct_face_2.CornerD))  # disabled
list_item_2 = ListItem(List=deconstruct_mesh_2.Vertices, Index=merge_4, Wrap=True)  # disabled
construct_mesh_2 = ConstructMesh(Vertices=list_item_2, Faces={A=0, B=1, C=2, D=3})  # -> flatten(Mesh); disabled
facade_panels_2 = Mesh(construct_mesh_2)  # disabled

# ----
tp_2 = FromTimeSpan(StartTime=construct_date_3, EndTime=construct_date_4, TimeStep=1, method="From Time Span", version="1.1.3.60000")  # disabled

# ---- group: Visualise Sun Rig
hemisphere_projection = HemisphereProjection(CyclopsValueList="Spherical", version="1.0.0.0")
number_slider_14 = Slider(1000, range=0..1000)
S = SunRigGeometry(
    SunRig=sun_rig,
    Position=pt,
    Scale=Slider(300, range=0..1000),
    HemisphereProjection=hemisphere_projection,
    method="Sun Rig Geometry",
    version="1.0.0.0")  # -> SunPositions, Compass, CompassText, Analemmas, DayCurves, CutOffCurve

# ----
panel_12 = Panel(tp_2)  # disabled
R_2 = SunRig(NorthVector=Vector(0, 1, 0), Location=C_2, TimePattern=tp_2, CutOffElevation=0, method="Sun Rig", version="1.0.0.0")  # disabled
number_slider_15 = Slider(10, range=0..10)
sun_rig_2 = CyclopsObject(R_2, version="0.0.0.DevBuild")  # disabled
number_slider_16 = Slider(300, range=0..1000)  # disabled
pt_2 = Point(<point referenced from the Rhino model>)  # disabled
colour_swatch_3 = ColourSwatch(SwatchColor=RGB(0, 0, 0))  # disabled

# ---- group: Visualise Sun Rig
hemisphere_projection_2 = HemisphereProjection(CyclopsValueList="Spherical", version="1.0.0.0")  # disabled
number_slider_17 = Slider(1000, range=0..1000)  # disabled
S_2 = SunRigGeometry(
    SunRig=sun_rig_2,
    Position=pt_2,
    Scale=number_slider_16,
    HemisphereProjection=hemisphere_projection_2,
    method="Sun Rig Geometry",
    version="1.0.0.0")  # -> SunPositions, Compass, CompassText, Analemmas, DayCurves, CutOffCurve; disabled

# ----
number_slider_18 = Slider(10, range=0..10)  # disabled
number_slider_19 = Slider(0.4, range=0..1)  # disabled
colour_swatch_4 = ColourSwatch(SwatchColor=RGB(0, 0, 0))  # disabled
pipeline_4 = GeometryPipeline(
    GroupByLayer=False,
    GroupByType=False,
    IncludeHidden=True,
    IncludeLocked=True,
    LayerFilter="*D3 New GF",
    NameFilter="*",
    SublayerFiltering=True,
    TypeFilter=4)
pipeline_5 = GeometryPipeline(
    GroupByLayer=False,
    GroupByType=False,
    IncludeHidden=True,
    IncludeLocked=True,
    LayerFilter="*D3 New L1 - L3",
    NameFilter="*",
    SublayerFiltering=True,
    TypeFilter=4)
construct_point_2 = ConstructPoint(XCoordinate=Slider(18, range=0..30), YCoordinate=Slider(544, range=0..1000), ZCoordinate=0)
curve_4 = Curve(pipeline_4)
curve_5 = Curve(pipeline_5)
concat = Concatenate(FragmentA=name_of_option, FragmentB="Total area (m2) = ")
building_mass_boundary_and_floors_3 = BuildingMassBoundaryAndFloors(BoundaryCurve=curve_4, NumberOfFloors=Slider(1, range=0..10), FloorHeight=Slider(3.8, range=0..10))  # -> Floors, Mass
building_mass_boundary_and_floors_4 = BuildingMassBoundaryAndFloors(BoundaryCurve=curve_5, NumberOfFloors=Slider(3, range=0..10), FloorHeight=Slider(3.3, range=0..10))  # -> Floors, Mass
cap_holes_3 = CapHoles(Brep=building_mass_boundary_and_floors_3.Mass)
cap_holes_4 = CapHoles(Brep=building_mass_boundary_and_floors_4.Mass)
area_5 = Area(Geometry=building_mass_boundary_and_floors_3.Floors)  # -> Area, Centroid
area_6 = Area(Geometry=building_mass_boundary_and_floors_4.Floors)  # -> Area, Centroid
custom_preview_5 = CustomPreview(Geometry=cap_holes_3, Material=ColourSwatch(SwatchColor=RGB(255, 128, 0)))
custom_preview_6 = CustomPreview(Geometry=cap_holes_4, Material=ColourSwatch(SwatchColor=RGB(255, 128, 0)))
construct_point_3 = ConstructPoint(XCoordinate=30, YCoordinate=Slider(575, range=0..1000), ZCoordinate=0)
mass_addition_3 = MassAddition(Input=area_5.Area)  # -> Result, PartialResults
mass_addition_4 = MassAddition(Input=area_6.Area)  # -> Result, PartialResults
wires_4 = BrepWireframe(Brep=[building_mass_boundary_and_floors_3.Floors, building_mass_boundary_and_floors_3.Mass], Density=-1)  # -> flatten(Wireframe)
wires_5 = BrepWireframe(Brep=[building_mass_boundary_and_floors_4.Floors, building_mass_boundary_and_floors_4.Mass], Density=-1)  # -> flatten(Wireframe)

# ---- group: Draw Curves with Custom Weights
thickness_4 = Slider(2, range=0..20)
dc_4 = DrawCurves(Curves=wires_4, Weight=thickness_4, Color=ColourSwatch(SwatchColor=RGB(237, 237, 237)))  # inputs Curves: list; same code as dc

thickness_5 = Slider(2, range=0..20)
dc_5 = DrawCurves(Curves=wires_5, Weight=thickness_5, Color=ColourSwatch(SwatchColor=RGB(237, 237, 237)))  # inputs Curves: list; same code as dc

# ----
panel_13 = Panel(area_5.Area)
panel_14 = Panel(mass_addition_3.Result)
panel_15 = Panel(area_6.Area)
panel_16 = Panel(mass_addition_4.Result)
mass_addition_5 = MassAddition(Input=flatten([panel_6, panel_8, panel_14, panel_16]))  # -> flatten(Result), PartialResults
panel_17 = Panel(mass_addition_5.Result)
concat_2 = Concatenate(FragmentA=concat, FragmentB=panel_17)
dst_2 = DrawScreenText(
    Text=concat_2,
    Color=ColourSwatch(SwatchColor=RGB(255, 255, 255)),
    Height=Slider(20, range=0..30),
    Point=construct_point_2)  # same code as dst
multiplication = Multiplication(A=panel_17, B=Slider(1.2, range=0..10))
panel_18 = Panel(multiplication)
round = Round(Number=panel_18)  # -> Nearest, Floor, Ceiling
concat_3 = Concatenate(FragmentA="GFA (m2) = ", FragmentB=round.Nearest)
dst_3 = DrawScreenText(
    Text=concat_3,
    Color=ColourSwatch(SwatchColor=RGB(255, 255, 255)),
    Height=Slider(16, range=0..30),
    Point=construct_point_3)  # same code as dst
division = Division(A=panel_18, B=Slider(0.9, range=0..1))
panel_19 = Panel(division)
construct_point_4 = ConstructPoint(XCoordinate=30, YCoordinate=Slider(604, range=0..1000), ZCoordinate=0)
round_2 = Round(Number=panel_19)  # -> Nearest, Floor, Ceiling
concat_4 = Concatenate(FragmentA="GBA (m2) = ", FragmentB=round_2.Nearest)
dst_4 = DrawScreenText(Text=concat_4, Color=ColourSwatch(SwatchColor=RGB(0, 0, 0)), Height=Slider(16, range=0..30), Point=construct_point_4)  # same code as dst
headers = Merge(Data1="Total area (m2) = ", Data2="GFA (m2) = ", Data3="GBA (m2) = ", Data4="FSR (total site) = ")

# ---- group: Values
merge_5 = Merge(Data1=panel_17, Data2=panel_18, Data3=panel_19, Data4="2600")

# ----
division_2 = Division(A=panel_18, B="2600")
flip = FlipMatrix(Data=merge_5)
construct_point_5 = ConstructPoint(XCoordinate=30, YCoordinate=Slider(634, range=0..1000), ZCoordinate=0)
path = FilePath("X:\2. Projects\2025\P25-062 Unions NSW Redevelopment\CAD\Rhino\File Copies for Alex (BIM)\Text.xlsx")
concatenate = Concatenate(FragmentA=division_2, FragmentB=":1")
concat_5 = Concatenate(FragmentA="FSR (total site) = ", FragmentB=concatenate)
dst_5 = DrawScreenText(Text=concat_5, Color=ColourSwatch(SwatchColor=RGB(0, 0, 0)), Height=Slider(16, range=0..30), Point=construct_point_5)  # same code as dst
excelwrite = ExcelWriter(
    WriteExcelData=Toggle(True),
    WorkbookPath=path,
    WorksheetName="Sheet1",
    ColumnHeadings=headers,
    Data=flip,
    ClearSheet=True,
    DataStruct=False)
panel_20 = Panel("Total NLA (m2)")
panel_21 = Panel("Max Permissible GFA")
panel_22 = Panel("Site area (m2)")

# ---- group: Create analysis points
face_normals = FaceNormals(Mesh=mesh_join)  # -> Centers, Normals

# ----
A = AnalysisPoint(Position=face_normals.Centers, Direction=face_normals.Normals, method="Analysis Point", version="1.0.0.0")
plane_normal = PlaneNormal(Origin=face_normals.Centers, ZAxis=face_normals.Normals)

# ---- group: Create analysis points (continued)
analysis_points = CyclopsObject(A, version="0.0.0.DevBuild")

# ---- group: Run sunlight hour analysis
analysis_points_2 = CyclopsObject(analysis_points, version="0.0.0.DevBuild")
sun_rig_3 = CyclopsObject(sun_rig, version="0.0.0.DevBuild")
scene_objects = CyclopsObject(G_2, version="0.0.0.DevBuild")
sunlight_hour_analysis = SunlightHourAnalysis(
    Run=Toggle(True),
    SceneObjects=scene_objects,
    SunRig=sun_rig_3,
    AnalysisPoints=analysis_points_2,
    VisibilityMask="""{
  "Mask1": true,
  "Mask2": true,
  "Mask3": true,
  "Mask4": true,
  "Mask5": true,
  "Mask6": true,
  "Mask7": true,
  "Mask8": true,
  "BitMap": [
    true,
    true,
    true,
    true,
    true,
    true,
    true,
    true
  ]
}""",
    method="Sunlight Hour Analysis",
    version="1.0.0.0")  # -> Scene, SunlightHours

# ---- group: Test Results
expected_1 = Number([7, 7, 7, 7, 7, 10, 10, 10, 11, 12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])
actual_1 = Number(sunlight_hour_analysis.SunlightHours)

# ----
text_tag_3d = TextTag3D(Location=plane_normal, Text=actual_1, Size=Slider(0.4, range=0..1), Colour=colour_swatch_3, Justification=7)
equals_3 = Equality(FirstNumber=sunlight_hour_analysis.SunlightHours, SecondNumber=Slider(0, range=0..100))  # -> Equality, Inequality
equals_4 = Equality(FirstNumber=sunlight_hour_analysis.SunlightHours, SecondNumber=Slider(1, range=0..100))  # -> Equality, Inequality
equals_5 = Equality(FirstNumber=sunlight_hour_analysis.SunlightHours, SecondNumber=Slider(2, range=0..100))  # -> Equality, Inequality
equals_6 = Equality(FirstNumber=sunlight_hour_analysis.SunlightHours, SecondNumber=Slider(3, range=0..100))  # -> Equality, Inequality
equals_7 = Equality(FirstNumber=sunlight_hour_analysis.SunlightHours, SecondNumber=Slider(4, range=0..100))  # -> Equality, Inequality
equals_8 = Equality(FirstNumber=sunlight_hour_analysis.SunlightHours, SecondNumber=Slider(5, range=0..100))  # -> Equality, Inequality
equals_9 = Equality(FirstNumber=sunlight_hour_analysis.SunlightHours, SecondNumber=Slider(6, range=0..100))  # -> Equality, Inequality
dispatch_3 = Dispatch(List=sunlight_hour_analysis.SunlightHours, DispatchPattern=equals_3.Equality)  # -> ListA, ListB
dispatch_4 = Dispatch(List=sunlight_hour_analysis.SunlightHours, DispatchPattern=equals_4.Equality)  # -> ListA, ListB
dispatch_5 = Dispatch(List=sunlight_hour_analysis.SunlightHours, DispatchPattern=equals_5.Equality)  # -> ListA, ListB
dispatch_6 = Dispatch(List=sunlight_hour_analysis.SunlightHours, DispatchPattern=equals_6.Equality)  # -> ListA, ListB
dispatch_7 = Dispatch(List=sunlight_hour_analysis.SunlightHours, DispatchPattern=equals_7.Equality)  # -> ListA, ListB
dispatch_8 = Dispatch(List=sunlight_hour_analysis.SunlightHours, DispatchPattern=equals_8.Equality)  # -> ListA, ListB
dispatch_9 = Dispatch(List=sunlight_hour_analysis.SunlightHours, DispatchPattern=equals_9.Equality)  # -> ListA, ListB
lng = ListLength(List=sunlight_hour_analysis.SunlightHours)
lng_2 = ListLength(List=dispatch_7.ListA)
lng_3 = ListLength(List=sunlight_hour_analysis.SunlightHours)
lng_4 = ListLength(List=dispatch_8.ListA)
lng_5 = ListLength(List=sunlight_hour_analysis.SunlightHours)
lng_6 = ListLength(List=dispatch_9.ListA)
lng_7 = ListLength(List=sunlight_hour_analysis.SunlightHours)
lng_8 = ListLength(List=dispatch_4.ListA)
lng_9 = ListLength(List=sunlight_hour_analysis.SunlightHours)
lng_10 = ListLength(List=dispatch_6.ListA)
lng_11 = ListLength(List=sunlight_hour_analysis.SunlightHours)
lng_12 = ListLength(List=dispatch_3.ListA)
lng_13 = ListLength(List=sunlight_hour_analysis.SunlightHours)
lng_14 = ListLength(List=dispatch_5.ListA)
division_3 = Division(A=lng_12, B=lng_11)
division_4 = Division(A=lng_8, B=lng_7)
division_5 = Division(A=lng_14, B=lng_13)
division_6 = Division(A=lng_10, B=lng_9)
division_7 = Division(A=lng_2, B=lng)
division_8 = Division(A=lng_4, B=lng_3)
division_9 = Division(A=lng_6, B=lng_5)
multiplication_2 = Multiplication(A=division_3, B=Slider(100, range=0..100))
multiplication_3 = Multiplication(A=division_4, B=Slider(100, range=0..100))
multiplication_4 = Multiplication(A=division_5, B=Slider(100, range=0..100))
multiplication_5 = Multiplication(A=division_6, B=Slider(100, range=0..100))
multiplication_6 = Multiplication(A=division_7, B=Slider(100, range=0..100))
multiplication_7 = Multiplication(A=division_8, B=Slider(100, range=0..100))
multiplication_8 = Multiplication(A=division_9, B=Slider(100, range=0..100))
panel_23 = Panel(multiplication_3)
panel_24 = Panel(multiplication_4)
panel_25 = Panel(multiplication_5)
panel_26 = Panel(multiplication_6)
panel_27 = Panel(multiplication_7)
panel_28 = Panel(multiplication_8)
panel_29 = Panel(multiplication_2)

# ---- group: Create analysis points
face_normals_2 = FaceNormals(Mesh=mesh_join_2)  # -> Centers, Normals; disabled

# ----
A_2 = AnalysisPoint(Position=face_normals_2.Centers, Direction=face_normals_2.Normals, method="Analysis Point", version="1.0.0.0")  # disabled
plane_normal_2 = PlaneNormal(Origin=face_normals_2.Centers, ZAxis=face_normals_2.Normals)  # disabled

# ---- group: Create analysis points (continued)
analysis_points_3 = CyclopsObject(A_2, version="0.0.0.DevBuild")  # disabled

# ---- group: Run sunlight hour analysis
boolean_toggle = BooleanToggle(True)  # disabled
scene_objects_2 = CyclopsObject(G_4, version="0.0.0.DevBuild")  # disabled
sun_rig_4 = CyclopsObject(sun_rig_2, version="0.0.0.DevBuild")  # disabled
analysis_points_4 = CyclopsObject(analysis_points_3, version="0.0.0.DevBuild")  # disabled
sunlight_hour_analysis_2 = SunlightHourAnalysis(
    Run=boolean_toggle,
    SceneObjects=scene_objects_2,
    SunRig=sun_rig_4,
    AnalysisPoints=analysis_points_4,
    VisibilityMask="""{
  "Mask1": true,
  "Mask2": true,
  "Mask3": true,
  "Mask4": true,
  "Mask5": true,
  "Mask6": true,
  "Mask7": true,
  "Mask8": true,
  "BitMap": [
    true,
    true,
    true,
    true,
    true,
    true,
    true,
    true
  ]
}""",
    method="Sunlight Hour Analysis",
    version="1.0.0.0")  # -> Scene, SunlightHours; disabled

# ---- group: Test Results
expected_1_2 = Number([7, 7, 7, 7, 7, 10, 10, 10, 11, 12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])  # disabled
actual_1_2 = Number(sunlight_hour_analysis_2.SunlightHours)  # disabled

# ----
text_tag_3d_2 = TextTag3D(Location=plane_normal_2, Text=actual_1_2, Size=number_slider_19, Colour=colour_swatch_4, Justification=7)  # disabled

# ---- group: Visualize analysis results on facade panels
analysis_results = Number(sunlight_hour_analysis.SunlightHours)
facade_panels_3 = Geometry(facade_panels)

# ----
gradient = Gradient(
    LowerLimit=0,
    UpperLimit=Slider(6, range=0..10),
    Parameter=analysis_results,
    stops=[0: RGB(64, 64, 0), 0.494: RGB(255, 255, 0), 1: RGB(255, 255, 255)])

# ---- group: Visualize analysis results on facade panels (continued)
mesh_colours = MeshColours(Mesh=graft(facade_panels_3), Colours=graft(gradient))

facade_panels_4 = Geometry(facade_panels_2)  # disabled
analysis_results_2 = Number(sunlight_hour_analysis_2.SunlightHours)  # disabled

# ----
gradient_2 = Gradient(
    LowerLimit=0,
    UpperLimit=number_slider_18,
    Parameter=analysis_results_2,
    stops=[0: RGB(64, 64, 0), 0.494: RGB(255, 255, 0), 1: RGB(255, 255, 255)])  # disabled

# ---- group: Visualize analysis results on facade panels (continued)
mesh_colours_2 = MeshColours(Mesh=graft(facade_panels_4), Colours=graft(gradient_2))  # disabled
